# Dynamo graph GridGenerator.dyn (Dynamo 1.3.4.6666)

# group: Grid Lengths
code_block = CodeBlock { 12000; }

# group: Vertical Grids
code_block_2 = CodeBlock { {"1", "2"}; }
code_block_3 = CodeBlock { {4000, 8000}; }
code_block_4 = CodeBlock { true; }
createGridInfo = Onbox.GridGenerator.Dynamo.GridGenerator.CreateGridInfo(code_block_2@L1, code_block_3@L1, code_block, code_block_4)

# group: Horizontal Grids
code_block_5 = CodeBlock { {"A", "B"}; }
code_block_6 = CodeBlock { {4000, 8000}; }
code_block_7 = CodeBlock { false; }
createGridInfo_2 = Onbox.GridGenerator.Dynamo.GridGenerator.CreateGridInfo(code_block_5@L1, code_block_6@L1, code_block, code_block_7)

join = List.Join(createGridInfo, createGridInfo_2)
generateRevitGrids = Onbox.GridGenerator.Dynamo.GridGenerator.GenerateRevitGrids(join)
