# Dynamo graph GridGenerator2.dyn (Dynamo 2.5.0.7460)

# group: Grid Lengths
integer_slider = IntegerSlider(14000, range=0..30000 step 1000)

# group: Vertical Grids
code_block = CodeBlock { ["1", "2"]; }
integer_slider_2 = IntegerSlider(4000, range=0..30000 step 1000)
integer_slider_3 = IntegerSlider(10000, range=0..30000 step 1000)
list_create = List.Create(item0=integer_slider_2, item1=integer_slider_3)
code_block_2 = CodeBlock { true; }
createGridInfo = Onbox.GridGenerator.Dynamo.GridGenerator.CreateGridInfo(name=code_block@L1, offset=list_create@L1, length=integer_slider, isVertical=code_block_2)

# group: Horizontal Grids
code_block_3 = CodeBlock { ["A", "B"]; }
integer_slider_4 = IntegerSlider(4000, range=0..30000 step 1000)
integer_slider_5 = IntegerSlider(10000, range=0..30000 step 1000)
list_create_2 = List.Create(item0=integer_slider_4, item1=integer_slider_5)
code_block_4 = CodeBlock { false; }
createGridInfo_2 = Onbox.GridGenerator.Dynamo.GridGenerator.CreateGridInfo(name=code_block_3@L1, offset=list_create_2@L1, length=integer_slider, isVertical=code_block_4)

join = List.Join(list0=createGridInfo, list1=createGridInfo_2)
generateRevitGrids = Onbox.GridGenerator.Dynamo.GridGenerator.GenerateRevitGrids(gridInfoList=join)
